% Simulink data dictionary SparkplugStateMachine.sldd

MQTT_Packet_Type = enum(DefaultValue="TCP_ESTABLISHED", StorageType="int32", AddClassNameToEnumNames=true)  % types of Sparkplug packets for SparkplugB
  TCP_ESTABLISHED = 0
  CONNECT = 1
  CONNACK = 2
  PUBLISH = 3
  PUBACK = 4
  SUBSCRIBE = 5
  SUBACK = 6

MqttPacket = Simulink.Bus()
  Will: uint32
  Type: Enum: MQTT_Packet_Type  % type of packet to send

HostPublication = Simulink.Signal()
EoNPublication = Simulink.Signal()
HostWill = Simulink.Signal(DataType="uint32", InitialValue="0")  % Will of the host
EoNWill = Simulink.Signal(DataType="uint32")